# Grasshopper definition bridge-parametric.gh (Grasshopper 1.0.8)

image_sampler = ImageSampler(
    FilePath="C:\Users\mikid\Downloads\Snipaste_2026-07-01_16-15-23.png",
    Filter="Colour",
    Interpolate=False,
    Umax=1,
    Umin=0,
    Vmax=1,
    Vmin=0,
    Wrap=1)
image_sampler_2 = ImageSampler(
    FilePath="C:\Users\mikid\Downloads\Snipaste_2026-07-01_16-20-10.png",
    Filter="Colour",
    Interpolate=False,
    Umax=1,
    Umin=0,
    Vmax=1,
    Vmin=0,
    Wrap=1)

# ---- group: 中间线往下降的距离
number_slider = Slider(0.6, range=0..2)

# ----
image_sampler_3 = ImageSampler(
    FilePath="C:\Users\mikid\Downloads\Snipaste_2026-07-01_16-12-47.png",
    Filter="Colour",
    Interpolate=False,
    Umax=1,
    Umin=0,
    Vmax=1,
    Vmin=0,
    Wrap=1)

# ---- group: 玻璃高度
number_slider_2 = Slider(1.2, range=0..10)

# ---- group: 每15度一个柱
number_slider_3 = Slider(24, range=0..100)

# ---- group: 两边预留
number_slider_4 = Slider(0.3, range=0..1)

# ----
image_sampler_4 = ImageSampler(
    FilePath="C:\Users\mikid\Downloads\Snipaste_2026-07-01_10-55-38.png",
    Filter="Colour",
    Interpolate=False,
    Umax=1,
    Umin=0,
    Vmax=1,
    Vmin=0,
    Wrap=1)

# ---- group: 外
curve = Curve(<curve referenced from the Rhino model>)

# ---- group: 内
curve_2 = Curve(<curve referenced from the Rhino model>)

# ----
flip_curve = FlipCurve(Curve=curve, Guide=curve_2)  # -> Curve, Flag

# ---- group: 决定玻璃密度*倍数
number_slider_5 = Slider(6, range=0..10)

# ----
# 外塔环形悬索桥
number_slider_6 = Slider(30, range=0..50)
# 四支点单索斜拉桥
curve_3 = Curve(<curve referenced from the Rhino model>)

# ---- group: 下
curve_4 = Curve(<curve referenced from the Rhino model>)

# ----
tween_curve = TweenCurve(CurveA=curve_2, CurveB=flip_curve.Curve, Factor=0.5, BlendType=0)

# ---- group: 上
curve_5 = Curve(<curve referenced from the Rhino model>)

# ---- group: 长
curve_6 = Curve(<curve referenced from the Rhino model>)

# ----
end_points = EndPoints(Curve=curve_3)  # -> Start, End

# ---- group: 短 拱
curve_7 = Curve(<curve referenced from the Rhino model>)

# ----
flip_curve_2 = FlipCurve(Curve=curve_4, Guide=curve_5)  # -> Curve, Flag

# ---- group: 不要触底
number_slider_7 = Slider(3.8, range=0..10)

# ----
divide_curve = DivideCurve(Curve=curve_6, Count=Slider(10, range=0..10), Kinks=False)  # -> Points, Tangents, Parameters
divide_curve_2 = DivideCurve(Curve=curve_5, Count=number_slider_6, Kinks=False)  # -> Points, Tangents, Parameters
divide_curve_3 = DivideCurve(Curve=curve_7, Count=Slider(5, range=0..10), Kinks=False)  # -> Points, Tangents, Parameters
divide_curve_4 = DivideCurve(Curve=flip_curve_2.Curve, Count=number_slider_6, Kinks=False)  # -> Points, Tangents, Parameters
point = Point(end_points.End)

# ---- group: 内
curve_8 = Curve(<curve referenced from the Rhino model>)

# ---- group: 外
curve_9 = Curve(<curve referenced from the Rhino model>)

# ---- group: Mirror / 对称轴
curve_10 = Curve(<curve referenced from the Rhino model>)
curve_11 = Curve(<curve referenced from the Rhino model>)

# ---- group: 向内缩
number_slider_8 = Slider(0.2, range=0..1)

# ---- group: 分段数
number_slider_9 = Slider(300, range=0..1000)

# ---- group: 栏杆高2
number_slider_10 = Slider(0.5, range=0..2)

# ---- group: 栏杆高1
number_slider_11 = Slider(0.8, range=0..1)

# ----
unit_z = UnitZ(Factor=number_slider_7)
line = Line(StartPoint=divide_curve_2.Points, EndPoint=divide_curve_4.Points)

offset_curve = OffsetCurve(Curve=flip_curve.Curve, Distance=expr("-x", number_slider_4), Corners=1)
offset_curve_2 = OffsetCurve(Curve=curve_2, Distance=number_slider_4, Corners=1)
multiplication = Multiplication(A=number_slider_3, B=number_slider_5)
divide_curve_5 = DivideCurve(Curve=offset_curve, Count=multiplication, Kinks=False)  # -> Points, Tangents, Parameters
divide_curve_6 = DivideCurve(Curve=offset_curve_2, Count=multiplication, Kinks=False)  # -> Points, Tangents, Parameters
shift_list = ShiftList(List=divide_curve_5.Points, Shift=1, Wrap=True)
shift_list_2 = ShiftList(List=divide_curve_6.Points, Shift=1, Wrap=True)
line_2 = Line(StartPoint=divide_curve_5.Points, EndPoint=shift_list)
line_3 = Line(StartPoint=divide_curve_6.Points, EndPoint=shift_list_2)
unit_z_2 = UnitZ(Factor=number_slider_2)
merge = Merge(Data1=line_3, Data2=line_2)

# ---- group: 中间斜撑*倍数
unit_z_3 = UnitZ(Factor=number_slider)
move = Move(Geometry=tween_curve, Motion=expr("-x", unit_z_3))  # -> Geometry, Transform
multiplication_2 = Multiplication(A=multiplication, B=Slider(3, range=0..10))
divide_curve_7 = DivideCurve(Curve=offset_curve_2, Count=multiplication_2, Kinks=False)  # -> Points, Tangents, Parameters
divide_curve_8 = DivideCurve(Curve=move.Geometry, Count=multiplication_2, Kinks=False)  # -> Points, Tangents, Parameters
divide_curve_9 = DivideCurve(Curve=offset_curve, Count=multiplication_2, Kinks=False)  # -> Points, Tangents, Parameters
line_4 = Line(StartPoint=divide_curve_8.Points, EndPoint=divide_curve_7.Points)
line_5 = Line(StartPoint=divide_curve_8.Points, EndPoint=divide_curve_9.Points)
merge_2 = Merge(Data1=line_4, Data2=line_5)

# ----
line_6 = Line(StartPoint=point, EndPoint=divide_curve.Points)
line_7 = Line(StartPoint=point, EndPoint=divide_curve_3.Points)
flip_curve_3 = FlipCurve(Curve=curve_9, Guide=curve_8)  # -> Curve, Flag

# ---- group: 底板
merge_3 = Merge(Data1=curve_2, Data2=flip_curve.Curve)
loft = Loft(Curves=merge_3, Options={Adjust=False, Closed=False, LoftEnds=0, LoftSimp=0, LoftType=0, Rebuild=10, Refit=0.01})

# ----
merge_4 = Merge(Data1=curve_6, Data2=curve_7)
move_2 = Move(Geometry=tween_curve, Motion=expr("-X", unit_z))  # -> Geometry, Transform

# ---- group: 底下墩子 / 二层高度
number_slider_12 = Slider(4.2, range=0..10)

# ----
merge_5 = Merge(Data1=line_6, Data2=line_7, Data3=merge_4)

# ---- group: Mirror
unit_z_4 = UnitZ(Factor=1)
extrude = Extrude(Base=curve_10, Direction=unit_z_4)
extrude_2 = Extrude(Base=curve_11, Direction=unit_z_4)
mirror = Mirror(Geometry=merge_5, Plane=extrude)  # -> Geometry, Transform
merge_6 = Merge(Data1=merge_5, Data2=mirror.Geometry)
mirror_2 = Mirror(Geometry=merge_6, Plane=extrude_2)  # -> Geometry, Transform

# ---- group: 内
divide_curve_10 = DivideCurve(Curve=curve_2, Count=number_slider_3, Kinks=False)  # -> Points, Tangents, Parameters

# ---- group: 外
divide_curve_11 = DivideCurve(Curve=flip_curve.Curve, Count=number_slider_3, Kinks=False)  # -> Points, Tangents, Parameters

# ---- group: 中
divide_curve_12 = DivideCurve(Curve=move_2.Geometry, Count=number_slider_3, Kinks=False)  # -> Points, Tangents, Parameters

# ---- group: 底下墩子 / 桩子高度
subtraction = Subtraction(A=number_slider_12, B=number_slider_7)

# ---- group: 底下墩子
number_slider_13 = Slider(0.6, range=0..1)
multiplication_3 = Multiplication(A=subtraction, B=Slider(0.5, range=0..1))
unit_z_5 = UnitZ(Factor=multiplication_3)
center_box = CenterBox(Base=divide_curve_12.Points, X=number_slider_13, Y=number_slider_13, Z=multiplication_3)
move_3 = Move(Geometry=center_box, Motion=expr("-x", unit_z_5))  # -> Geometry, Transform

# ---- group: 挤一个厚度
unit_z_6 = UnitZ(Factor=Slider(0.1, range=0..1))
extrude_3 = Extrude(Base=loft, Direction=unit_z_6)

# ---- group: 圆弧内栏杆
curve_12 = Curve(curve_8)

# ---- group: 圆弧外栏杆
curve_13 = Curve(flip_curve_3.Curve)

# ----
tween_curve_2 = TweenCurve(CurveA=curve_8, CurveB=flip_curve_3.Curve, Factor=0.5, BlendType=0)

# ---- group: 栏杆竖
merge_7 = Merge(Data1=divide_curve_6.Points, Data2=divide_curve_5.Points)
line_sdl = LineSDL(Start=merge_7, Direction=unit_z_2, Length=unit_z_2)
curve_14 = Curve(line_sdl)

# ---- group: 中间斜撑*倍数 / 中间斜撑
join_curves = JoinCurves(Curves=merge_2, Preserve=False)

# ----
unit_z_7 = UnitZ(Factor=number_slider_11)

# ---- group: 斜的楔柱子
line_8 = Line(StartPoint=divide_curve_12.Points, EndPoint=divide_curve_10.Points)
line_9 = Line(StartPoint=divide_curve_12.Points, EndPoint=divide_curve_11.Points)
merge_8 = Merge(Data1=line_8, Data2=line_9)

# ----
join_curves_2 = JoinCurves(Curves=[mirror_2.Geometry, merge_6], Preserve=False)

# ---- group: 中间斜撑*倍数 / 中间龙骨线
curve_15 = Curve(move.Geometry)

# ---- group: 中间龙骨线Pipe
pipe = Pipe(Curve=curve_15, Radius=Slider(0.1, range=0..0.1), Caps="2", FitRail=False)

# ---- group: 中间斜撑Pipe
pipe_2 = Pipe(Curve=join_curves, Radius=Slider(0.05, range=0..0.1), Caps="2", FitRail=False)

# ---- group: 分段线
move_4 = Move(Geometry=curve_12, Motion=unit_z_7)  # -> Geometry, Transform

# ----
group = Group(Geometry=flatten(join_curves_2))

# ---- group: 分段线
move_5 = Move(Geometry=curve_13, Motion=unit_z_7)  # -> Geometry, Transform

# ---- group: 玻璃
extrude_4 = Extrude(Base=merge, Direction=unit_z_2)

# ----
curve_16 = Curve(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)
geometry = Geometry(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)
flow = Flow(Geometry=geometry, Base=curve_16, Target=merge_8, ReverseBase=False, ReverseTarget=False, Stretch=True, Rigid=False)

number_slider_14 = Slider(12, range=0..20)

# ---- group: 圆弧中线
curve_17 = Curve(tween_curve_2)

# ----
unit_z_8 = UnitZ(Factor=Slider(0.5, range=0..1))

divide_curve_13 = DivideCurve(Curve=move_5.Geometry, Count=number_slider_9, Kinks=False)  # -> Points, Tangents, Parameters
divide_curve_14 = DivideCurve(Curve=move_4.Geometry, Count=number_slider_9, Kinks=False)  # -> Points, Tangents, Parameters

divide_curve_15 = DivideCurve(Curve=curve_12, Count=number_slider_9, Kinks=False)  # -> Points, Tangents, Parameters
divide_curve_16 = DivideCurve(Curve=curve_13, Count=number_slider_9, Kinks=False)  # -> Points, Tangents, Parameters

# ---- group: 外向内off
offset_curve_3 = OffsetCurve(Curve=move_5.Geometry, Distance=expr("-x", number_slider_8), Corners=1)

# ----
group_2 = Group(Geometry=flatten(flow))
group_3 = Group(Geometry=flatten(curve_14))
group_4 = Group(Geometry=flatten(move_3.Geometry))
group_5 = Group(Geometry=flatten(extrude_4))
group_6 = Group(Geometry=flatten(pipe_2))

# ---- group: 内向外off
offset_curve_4 = OffsetCurve(Curve=move_4.Geometry, Distance=number_slider_8, Corners=1)

# ----
move_6 = Move(Geometry=curve_17, Motion=expr("-x", unit_z_8))  # -> Geometry, Transform
divide_curve_17 = DivideCurve(Curve=flip_curve_3.Curve, Count=number_slider_14, Kinks=False)  # -> Points, Tangents, Parameters
divide_curve_18 = DivideCurve(Curve=tween_curve_2, Count=number_slider_14, Kinks=False)  # -> Points, Tangents, Parameters
divide_curve_19 = DivideCurve(Curve=curve_8, Count=number_slider_14, Kinks=False)  # -> Points, Tangents, Parameters
unit_z_9 = UnitZ(Factor=number_slider_10)
unit_z_10 = UnitZ(Factor=number_slider_10)
number_slider_15 = Slider(0, range=0..100)
merge_9 = Merge(Data1=group_3, Data2=group_5, Data3=group_6, Data4=pipe, Data5=extrude_3, Data6=group_2, Data7=group_4)
unit_z_11 = UnitZ(Factor=number_slider_11)
block_instance = BlockInstance(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)
deconstruct = Deconstruct(Point=divide_curve_19.Points)  # -> XComponent, YComponent, ZComponent

# ---- group: 沉底
list_item = ListItem(List=deconstruct.ZComponent, Index=0, Wrap=True)
unit_z_12 = UnitZ(Factor=list_item)
move_7 = Move(Geometry=tween_curve_2, Motion=expr("-x", unit_z_12))  # -> Geometry, Transform

# ----
divide_curve_20 = DivideCurve(Curve=move_7.Geometry, Count=Slider(10, range=0..10), Kinks=False)  # -> Points, Tangents, Parameters
deconstruct_2 = Deconstruct(Point=divide_curve_18.Points)  # -> XComponent, YComponent, ZComponent
deconstruct_3 = Deconstruct(Point=divide_curve_17.Points)  # -> XComponent, YComponent, ZComponent
move_8 = Move(Geometry=offset_curve_4, Motion=unit_z_10)  # -> Geometry, Transform
move_9 = Move(Geometry=offset_curve_3, Motion=unit_z_9)  # -> Geometry, Transform
divide_curve_21 = DivideCurve(Curve=move_6.Geometry, Count=number_slider_9, Kinks=False)  # -> Points, Tangents, Parameters
merge_10 = Merge(Data1=curve_12, Data2=curve_13)

list_length = ListLength(List=divide_curve_14.Points)
divide_curve_22 = DivideCurve(Curve=move_8.Geometry, Count=list_length, Kinks=False)  # -> Points, Tangents, Parameters

point_2 = Point(Point(-4000.730899, 1521.23259, 0))

# ---- group: 内纯竖
line_sdl_2 = LineSDL(Start=divide_curve_15.Points, Direction=unit_z_11, Length=unit_z_11)

# ---- group: 外纯竖
line_sdl_3 = LineSDL(Start=divide_curve_16.Points, Direction=unit_z_11, Length=unit_z_11)

# ----
construct_point = ConstructPoint(XCoordinate=deconstruct.XComponent, YCoordinate=deconstruct.YComponent, ZCoordinate=number_slider_15)
construct_point_2 = ConstructPoint(XCoordinate=deconstruct_2.XComponent, YCoordinate=deconstruct_2.YComponent, ZCoordinate=number_slider_15)
construct_point_3 = ConstructPoint(XCoordinate=deconstruct_3.XComponent, YCoordinate=deconstruct_3.YComponent, ZCoordinate=number_slider_15)

list_length_2 = ListLength(List=divide_curve_13.Points)
divide_curve_23 = DivideCurve(Curve=move_9.Geometry, Count=list_length_2, Kinks=False)  # -> Points, Tangents, Parameters

orient = Orient(Geometry=block_instance, Source=point_2, Target=simplify(graft(divide_curve_20.Points)))  # -> simplify(Geometry), Transform
extrude_5 = Extrude(Base=merge_10, Direction=unit_z_11)

# ---- group: 外斜肋
line_10 = Line(StartPoint=divide_curve_21.Points, EndPoint=divide_curve_16.Points)

# ---- group: 内斜肋
line_11 = Line(StartPoint=divide_curve_21.Points, EndPoint=divide_curve_15.Points)

# ----
line_12 = Line(StartPoint=divide_curve_18.Points, EndPoint=construct_point_2)
line_13 = Line(StartPoint=divide_curve_19.Points, EndPoint=construct_point)
line_14 = Line(StartPoint=divide_curve_17.Points, EndPoint=construct_point_3)
vector_2pt = Vector2Pt(PointA=divide_curve_14.Points, PointB=divide_curve_22.Points, Unitize=False)  # -> Vector, Length

shift_list_3 = ShiftList(List=divide_curve_14.Points, Shift=1, Wrap=True)
line_15 = Line(StartPoint=divide_curve_14.Points, EndPoint=shift_list_3)
vector = Vector(vector_2pt.Vector)
multiplication_4 = Multiplication(A=vector, B=Slider(1.2, range=0..10))

vector_2pt_2 = Vector2Pt(PointA=divide_curve_13.Points, PointB=divide_curve_23.Points, Unitize=False)  # -> Vector, Length

shift_list_4 = ShiftList(List=divide_curve_13.Points, Shift=1, Wrap=True)
line_16 = Line(StartPoint=divide_curve_13.Points, EndPoint=shift_list_4)
vector_2 = Vector(vector_2pt_2.Vector)
multiplication_5 = Multiplication(A=vector_2, B=Slider(1.2, range=0..10))

divide_curve_24 = DivideCurve(Curve=line_12, Count=number_slider_14, Kinks=False)  # -> simplify(Points), Tangents, Parameters; disabled

# ---- group: 外倾斜玻璃
extrude_6 = Extrude(Base=line_16, Direction=multiplication_5)  # -> simplify(Extrusion)

# ---- group: 内倾斜玻璃
extrude_7 = Extrude(Base=line_15, Direction=multiplication_4)  # -> simplify(Extrusion)

# ---- group: 内斜竖
line_17 = Line(StartPoint=divide_curve_14.Points, EndPoint=divide_curve_22.Points)

# ---- group: 外斜竖
line_18 = Line(StartPoint=divide_curve_13.Points, EndPoint=divide_curve_23.Points)

# ----
list_item_2 = ListItem(List=divide_curve_24.Points, Index=0, Wrap=True)  # -> Item, Item1, Item2, Item3; disabled
merge_11 = Merge(Data1=line_17, Data2=line_sdl_2, Data3=line_11)  # -> simplify(flatten(Result))
merge_12 = Merge(Data1=line_18, Data2=line_sdl_3, Data3=line_10)  # -> simplify(flatten(Result))
join_curves_3 = JoinCurves(Curves=merge_12, Preserve=False)
join_curves_4 = JoinCurves(Curves=merge_11, Preserve=False)

# ---- group: 内骨架
merge_13 = Merge(Data1=join_curves_4, Data2=join_curves_3)  # -> simplify(graft(Result))

# ---- group: 外骨架2
offset_curve_5 = OffsetCurve(Curve=merge_13, Distance=Slider(0.2, range=0..0.5), Corners=1)  # -> simplify(graft(Curve))

# ---- group: 玻璃集合
merge_14 = Merge(Data1=extrude_7, Data2=extrude_6, Data3=extrude_5)

# ---- group: 双向骨架
merge_15 = Merge(Data1=line_11, Data2=line_10)

# ---- group: 主缆
pipe_3 = Pipe(Curve=move_6.Geometry, Radius=Slider(0.1, range=0..1), Caps=0, FitRail=False)

# ---- group: 竖向柱
curve_18 = Curve(line_12)

# ----
group_7 = Group(Geometry=flatten(merge_14))
join_curves_5 = JoinCurves(Curves=merge_15, Preserve=False)
merge_16 = Merge(Data1=merge_13, Data2=offset_curve_5)

# ---- group: 底版
merge_17 = Merge(Data1=curve_8, Data2=flip_curve_3.Curve)
loft_2 = Loft(Curves=merge_17, Options={Adjust=False, Closed=False, LoftEnds=0, LoftSimp=0, LoftType=0, Rebuild=10, Refit=0.01})

# ----
group_8 = Group(Geometry=flatten(curve_18))
group_9 = Group(Geometry=orient.Geometry)
loft_3 = Loft(Curves=merge_16, Options={Adjust=False, Closed=False, LoftEnds=0, LoftSimp=0, LoftType=0, Rebuild=10, Refit=0.01})
group_10 = Group(Geometry=flatten(join_curves_5))
offset_surface = OffsetSurface(Surface=loft_3, Distance=Slider(0.2, range=0..1), Retrim=True)
merge_18 = Merge(Data1=group_7, Data2=pipe_3, Data3=group_10, Data4=loft_2, Data5=group_8, Data6=loft_3, Data7=group_9)
