# Grasshopper definition curtain-wall-stone-joint.gh (Grasshopper 1.0.8)
# plug-ins: Blindfold, Moonlight, LunchBox

moonlight = Moonlight(Mode=False)
# 横
# 竖（竖向纹理）
number_slider = Slider(4.8, range=0..10)
curve = Curve(<curve referenced from the Rhino model>)
curve_2 = Curve(<curve referenced from the Rhino model>)
surface = Surface(<surface referenced from the Rhino model>)
curve_3 = Curve(<curve referenced from the Rhino model>)
end_points = EndPoints(Curve=curve_2)  # -> Start, End
divide_length = DivideLength(Curve=curve_3, Length=number_slider)  # -> Points, Tangents, Parameters
random_quad_panels = RandomQuadPanels(
    Surface=surface,
    UDivisions=Slider(10, range=0..100),
    VDivisions=Slider(82, range=0..100),
    RandomSeed=Slider(522, range=0..1000))
blindfold = Blindfold(Refresh=Button(), Visibility=Toggle(True), Limited=<surface referenced from the Rhino model>)
orient = Orient(Geometry=curve_2, Source=end_points.Start, Target=divide_length.Points)  # -> Geometry, Transform
