# Grasshopper definition facade-4in1-skin.gh (Grasshopper 1.0.8)

image_sampler = ImageSampler(
    FilePath="C:\Users\mikid\Pictures\Snipaste自动保存\3.png",
    Filter="Colour",
    Interpolate=False,
    Umax=1,
    Umin=0,
    Vmax=1,
    Vmin=0,
    Wrap=1)
image_sampler_2 = ImageSampler(
    FilePath="C:\Users\mikid\Pictures\Snipaste自动保存\1.png",
    Filter="Colour",
    Interpolate=False,
    Umax=1,
    Umin=0,
    Vmax=1,
    Vmin=0,
    Wrap=1)
image_sampler_3 = ImageSampler(
    FilePath="C:\Users\mikid\Pictures\Snipaste自动保存\2.png",
    Filter="Colour",
    Interpolate=False,
    Umax=1,
    Umin=0,
    Vmax=1,
    Vmin=0,
    Wrap=1)
image_sampler_4 = ImageSampler(
    FilePath="C:\Users\mikid\Pictures\Snipaste自动保存\4.png",
    Filter="Colour",
    Interpolate=False,
    Umax=1,
    Umin=0,
    Vmax=1,
    Vmin=0,
    Wrap=1)
curve = Curve(<curve referenced from the Rhino model>)
unit_z = UnitZ(Factor=Slider(4.8, range=0..10))
unit_z_2 = UnitZ(Factor=Slider(5.5, range=0..10))
number_slider = Slider(4.8, range=0..10)
unit_z_3 = UnitZ(Factor=Slider(4.8, range=0..10))
unit_z_4 = UnitZ(Factor=Slider(5.5, range=0..10))

end_points = EndPoints(Curve=curve)  # -> Start, End
pi = Pi(Factor=1)
vector_2pt = Vector2Pt(PointA=end_points.Start, PointB=end_points.End, Unitize=False)  # -> unitize(Vector), Length
multiplication = Multiplication(A=pi, B=Slider(0.5, range=0..1))
rotate = Rotate(Geometry=vector_2pt.Vector, Angle=multiplication, Plane=PlaneXY(0, 0, 0))  # -> Geometry, Transform

unit_z_5 = UnitZ(Factor=Slider(5.5, range=0..10))
unit_z_6 = UnitZ(Factor=Slider(4.8, range=0..10))
move = Move(Geometry=curve, Motion=expr("-x", unit_z_2))  # -> Geometry, Transform
unit_z_7 = UnitZ(Factor=Slider(4.2, range=0..10))
unit_z_8 = UnitZ(Factor=Slider(5.5, range=0..10))
move_2 = Move(Geometry=move.Geometry, Motion=expr("-x", unit_z_4))  # -> Geometry, Transform
number_slider_2 = Slider(50, range=0..100)
unit_z_9 = UnitZ(Factor=Slider(4.2, range=0..10))
move_3 = Move(Geometry=move_2.Geometry, Motion=expr("-x", unit_z_5))  # -> Geometry, Transform
number_slider_3 = Slider(50, range=0..100)
curve_2 = Curve(<curve referenced from the Rhino model>)
move_4 = Move(Geometry=move_3.Geometry, Motion=expr("-x", unit_z_8))  # -> Geometry, Transform
unit_z_10 = UnitZ(Factor=number_slider)
move_5 = Move(Geometry=curve_2, Motion=expr("-x", unit_z_10))  # -> Geometry, Transform
move_6 = Move(Geometry=move_5.Geometry, Motion=expr("-x", unit_z))  # -> Geometry, Transform
move_7 = Move(Geometry=move_6.Geometry, Motion=expr("-x", unit_z_3))  # -> Geometry, Transform
move_8 = Move(Geometry=move_7.Geometry, Motion=expr("-x", unit_z_6))  # -> Geometry, Transform
move_9 = Move(Geometry=move_8.Geometry, Motion=expr("-x", unit_z_7))  # -> Geometry, Transform
move_10 = Move(Geometry=move_4.Geometry, Motion=expr("-x", unit_z_9))  # -> Geometry, Transform; disabled

# ---- group: 垂直向量
end_points_2 = EndPoints(Curve=curve_2)  # -> Start, End
pi_2 = Pi(Factor=1)
vector_2pt_2 = Vector2Pt(PointA=end_points_2.Start, PointB=end_points_2.End, Unitize=False)  # -> unitize(Vector), Length
multiplication_2 = Multiplication(A=pi_2, B=Slider(0.5, range=0..1))
rotate_2 = Rotate(Geometry=vector_2pt_2.Vector, Angle=multiplication_2, Plane=PlaneXY(0, 0, 0))  # -> Geometry, Transform

# ---- group: Top3层层高
number_slider_4 = Slider(7, range=0..10)

# ---- group: Top2层层高
number_slider_5 = Slider(7, range=0..10)

# ---- group: 顶层层高
number_slider_6 = Slider(8, range=0..10)

# ----
divide_curve = DivideCurve(Curve=curve_2, Count=number_slider_2, Kinks=False)  # -> Points, Tangents, Parameters
divide_curve_2 = DivideCurve(Curve=move_5.Geometry, Count=number_slider_2, Kinks=False)  # -> Points, Tangents, Parameters

# ---- group: double facade length
number_slider_7 = Slider(0.75, range=0..1)

# ----
divide_curve_3 = DivideCurve(Curve=move_6.Geometry, Count=number_slider_2, Kinks=False)  # -> Points, Tangents, Parameters
divide_curve_4 = DivideCurve(Curve=curve, Count=number_slider_3, Kinks=False)  # -> Points, Tangents, Parameters
curve_3 = Curve(<curve referenced from the Rhino model>)
divide_curve_5 = DivideCurve(Curve=move.Geometry, Count=number_slider_3, Kinks=False)  # -> Points, Tangents, Parameters
divide_curve_6 = DivideCurve(Curve=move_7.Geometry, Count=number_slider_2, Kinks=False)  # -> Points, Tangents, Parameters
divide_curve_7 = DivideCurve(Curve=move_2.Geometry, Count=number_slider_3, Kinks=False)  # -> Points, Tangents, Parameters
divide_curve_8 = DivideCurve(Curve=move_8.Geometry, Count=number_slider_2, Kinks=False)  # -> Points, Tangents, Parameters
divide_curve_9 = DivideCurve(Curve=move_9.Geometry, Count=number_slider_2, Kinks=False)  # -> Points, Tangents, Parameters
divide_curve_10 = DivideCurve(Curve=move_3.Geometry, Count=number_slider_3, Kinks=False)  # -> Points, Tangents, Parameters

vector = Vector(rotate.Geometry)
multiplication_3 = Multiplication(A=vector, B=number_slider_7)

divide_curve_11 = DivideCurve(Curve=move_4.Geometry, Count=number_slider_3, Kinks=False)  # -> Points, Tangents, Parameters
divide_curve_12 = DivideCurve(Curve=move_10.Geometry, Count=number_slider_3, Kinks=False)  # -> Points, Tangents, Parameters

# ---- group: pt group
merge = Merge(
    Data1=divide_curve_4.Points,
    Data2=divide_curve_5.Points,
    Data3=divide_curve_7.Points,
    Data4=divide_curve_10.Points,
    Data5=divide_curve_11.Points,
    Data6=divide_curve_12.Points)

# ---- group: 横向间距
number_slider_8 = Slider(4.18, range=0..10)

# ---- group: 竖向分
number_slider_9 = Slider(23, range=0..100)

# ----
addition = Addition(A=number_slider_6, B=number_slider_5)
vector_2pt_3 = Vector2Pt(PointA=divide_curve.Points, PointB=divide_curve_2.Points, Unitize=False)  # -> Vector, Length
addition_2 = Addition(A=addition, B=number_slider_4)

# ---- group: 格栅数
number_slider_10 = Slider(50, range=0..100)

# ---- group: 挤出距离 / double facade length
number_slider_11 = Slider(0.2, range=0..1)

# ----
vector_2pt_4 = Vector2Pt(PointA=divide_curve_2.Points, PointB=divide_curve_3.Points, Unitize=False)  # -> Vector, Length
extrude = Extrude(Base=merge, Direction=multiplication_3)
# 最上线条
curve_4 = Curve(<curve referenced from the Rhino model>)
# 竖向小条条
geometry = Geometry([<extrusion referenced from the Rhino model> x85])
vector_2pt_5 = Vector2Pt(PointA=divide_curve_4.Points, PointB=divide_curve_5.Points, Unitize=False)  # -> Vector, Length

# ---- group: 顶层层高
unit_z_11 = UnitZ(Factor=number_slider_6)
move_11 = Move(Geometry=curve_3, Motion=expr("-x", unit_z_11))  # -> Geometry, Transform
curve_5 = Curve(move_11.Geometry)

# ----
vector_2pt_6 = Vector2Pt(PointA=divide_curve_3.Points, PointB=divide_curve_6.Points, Unitize=False)  # -> Vector, Length

unit_z_12 = UnitZ(Factor=addition)
move_12 = Move(Geometry=curve_3, Motion=expr("-x", unit_z_12))  # -> Geometry, Transform
curve_6 = Curve(move_12.Geometry)

vector_2pt_7 = Vector2Pt(PointA=divide_curve_5.Points, PointB=divide_curve_7.Points, Unitize=False)  # -> Vector, Length
vector_2pt_8 = Vector2Pt(PointA=divide_curve_6.Points, PointB=divide_curve_8.Points, Unitize=False)  # -> Vector, Length

# ---- group: 横
merge_2 = Merge(
    Data1=curve,
    Data2=move.Geometry,
    Data3=move_2.Geometry,
    Data4=move_3.Geometry,
    Data5=move_4.Geometry,
    Data6=move_10.Geometry)

# ----
vector_2pt_9 = Vector2Pt(PointA=divide_curve_7.Points, PointB=divide_curve_10.Points, Unitize=False)  # -> Vector, Length

unit_z_13 = UnitZ(Factor=addition_2)
move_13 = Move(Geometry=curve_3, Motion=expr("-x", unit_z_13))  # -> Geometry, Transform
curve_7 = Curve(move_13.Geometry)

brep = Brep(geometry)
vector_2pt_10 = Vector2Pt(PointA=divide_curve_10.Points, PointB=divide_curve_11.Points, Unitize=False)  # -> Vector, Length

# ---- group: uo to down vectors
merge_3 = Merge(Data1=vector_2pt_5.Vector, Data2=vector_2pt_7.Vector, Data3=vector_2pt_9.Vector, Data4=vector_2pt_10.Vector)

# ---- group: 挤出距离
vector_2 = Vector(rotate_2.Geometry)
multiplication_4 = Multiplication(A=vector_2, B=number_slider_11)

# ----
line = Line(StartPoint=divide_curve.Points, EndPoint=divide_curve_2.Points)
line_2 = Line(StartPoint=divide_curve_2.Points, EndPoint=divide_curve_3.Points)
line_3 = Line(StartPoint=divide_curve_4.Points, EndPoint=divide_curve_5.Points)
line_4 = Line(StartPoint=divide_curve_3.Points, EndPoint=divide_curve_6.Points)
line_5 = Line(StartPoint=divide_curve_5.Points, EndPoint=divide_curve_7.Points)
line_6 = Line(StartPoint=divide_curve_6.Points, EndPoint=divide_curve_8.Points)
line_7 = Line(StartPoint=divide_curve_8.Points, EndPoint=divide_curve_9.Points)
line_8 = Line(StartPoint=divide_curve_7.Points, EndPoint=divide_curve_10.Points)
series = Series(Start=0, Step=1, Count=number_slider_9)
line_9 = Line(StartPoint=divide_curve_10.Points, EndPoint=divide_curve_11.Points)
line_10 = Line(StartPoint=divide_curve_11.Points, EndPoint=divide_curve_12.Points)

# ---- group: 竖
merge_4 = Merge(Data1=line_3, Data2=line_5, Data3=line_8, Data4=line_9, Data5=line_10)

# ---- group: 框架
merge_5 = Merge(Data1=merge_4, Data2=merge_2)  # -> flatten(Result)

# ----
move_14 = Move(Geometry=merge_5, Motion=multiplication_3)  # -> Geometry, Transform

# ---- group: 框架
group = Group(Geometry=flatten([extrude, move_14.Geometry]))

# ----
construct_domain = ConstructDomain(DomainStart=0, DomainEnd=1)
range = Range(Domain=construct_domain, Steps=number_slider_10)
graph_mapper = GraphMapper(range, x0=0, x1=1, y0=0, y1=1, container_name="Sine", Equation_px=[0, 0.3840579689], Equation_py=[0, 0.669081986])
multiplication_5 = Multiplication(A=graph_mapper, B=Slider(3, range=0..10))
unit_x = UnitX(Factor=multiplication_5)

unit_z_14 = UnitZ(Factor=series)

construct_domain_2 = ConstructDomain(DomainStart=0, DomainEnd=1)
range_2 = Range(Domain=construct_domain_2, Steps=number_slider_10)
graph_mapper_2 = GraphMapper(
    range_2,
    x0=0,
    x1=1,
    y0=0,
    y1=1,
    container_name="Sine",
    Equation_px=[0.6105319858, 1],
    Equation_py=[0.3347584009, 0.7451800108])
multiplication_6 = Multiplication(A=graph_mapper_2, B=Slider(2, range=0..10))
unit_x_2 = UnitX(Factor=multiplication_6)

unit_z_15 = UnitZ(Factor=Slider(0.2, range=0..1))

construct_domain_3 = ConstructDomain(DomainStart=0, DomainEnd=1)
range_3 = Range(Domain=construct_domain_3, Steps=number_slider_10)
graph_mapper_3 = GraphMapper(
    range_3,
    x0=0,
    x1=1,
    y0=0,
    y1=1,
    container_name="Sine",
    Equation_px=[0.5787450671, 0.9617521763],
    Equation_py=[0.07487773895, 0.9676805735])
multiplication_7 = Multiplication(A=graph_mapper_3, B=Slider(3, range=0..10))
unit_x_3 = UnitX(Factor=multiplication_7)

pi_3 = Pi(Factor=1)
multiplication_8 = Multiplication(A=pi_3, B=Slider(0.5, range=0..1))

end_points_3 = EndPoints(Curve=curve_4)  # -> Start, End
vector_2pt_11 = Vector2Pt(PointA=end_points_3.Start, PointB=end_points_3.End, Unitize=False)  # -> Vector, Length
unit_vector = UnitVector(Vector=vector_2pt_11.Vector)
rotate_3 = Rotate(Geometry=unit_vector, Angle=multiplication_8, Plane=PlaneXY(0, 0, 0))  # -> Geometry, Transform

move_15 = Move(Geometry=curve_4, Motion=expr("-x", unit_z_14))  # -> Geometry, Transform

# ---- group: 0，1，0，1
series_2 = Series(Start=0, Step=1, Count=number_slider_9)
modulus = Modulus(A=series_2, B=Slider(2, range=0..10))
panel = Panel(modulus)
dispatch = Dispatch(List=move_15.Geometry, DispatchPattern=modulus)  # -> ListA, ListB

# ----
shift_list = ShiftList(List=line_6, Shift=1, Wrap=False)
shift_list_2 = ShiftList(List=line_7, Shift=1, Wrap=False)
shift_list_3 = ShiftList(List=line_4, Shift=1, Wrap=False)
shift_list_4 = ShiftList(List=line_2, Shift=1, Wrap=False)
shift_list_5 = ShiftList(List=line, Shift=1, Wrap=False)
shift_list_6 = ShiftList(List=line_9, Shift=1, Wrap=False)
shift_list_7 = ShiftList(List=line_10, Shift=1, Wrap=False)
shift_list_8 = ShiftList(List=line_8, Shift=1, Wrap=False)
shift_list_9 = ShiftList(List=line_5, Shift=1, Wrap=False)
divide_length = DivideLength(Curve=curve_4, Length=number_slider_8)  # -> Points, Tangents, Parameters
shift_list_10 = ShiftList(List=line_3, Shift=1, Wrap=False)

# ---- group: 横断
extrude_2 = Extrude(Base=merge_2, Direction=multiplication_3)

# ----
reverse_list = ReverseList(List=move_15.Geometry)
list_item = ListItem(List=reverse_list, Index=0, Wrap=True)
list_item_2 = ListItem(List=move_15.Geometry, Index=0, Wrap=True)
end_points_4 = EndPoints(Curve=curve_4)  # -> Start, End
end_points_5 = EndPoints(Curve=list_item)  # -> Start, End
line_11 = Line(StartPoint=end_points_4.Start, EndPoint=end_points_5.Start)

merge_6 = Merge(Data1=simplify(graft(line_6)), Data2=simplify(graft(shift_list)))
merge_7 = Merge(Data1=simplify(graft(line_7)), Data2=simplify(graft(shift_list_2)))
merge_8 = Merge(Data1=simplify(graft(line_4)), Data2=simplify(graft(shift_list_3)))
merge_9 = Merge(Data1=simplify(graft(line_2)), Data2=simplify(graft(shift_list_4)))
merge_10 = Merge(Data1=simplify(graft(line)), Data2=simplify(graft(shift_list_5)))

divide_curve_13 = DivideCurve(Curve=curve_3, Count=number_slider_10, Kinks=False)  # -> Points, Tangents, Parameters
divide_curve_14 = DivideCurve(Curve=curve_5, Count=number_slider_10, Kinks=False)  # -> Points, Tangents, Parameters
divide_curve_15 = DivideCurve(Curve=curve_6, Count=number_slider_10, Kinks=False)  # -> Points, Tangents, Parameters
divide_curve_16 = DivideCurve(Curve=curve_7, Count=number_slider_10, Kinks=False)  # -> Points, Tangents, Parameters

merge_11 = Merge(Data1=simplify(graft(line_9)), Data2=simplify(graft(shift_list_6)))
merge_12 = Merge(Data1=simplify(graft(line_10)), Data2=simplify(graft(shift_list_7)))
merge_13 = Merge(Data1=simplify(graft(line_8)), Data2=simplify(graft(shift_list_8)))
merge_14 = Merge(Data1=simplify(graft(line_5)), Data2=simplify(graft(shift_list_9)))
merge_15 = Merge(Data1=simplify(graft(line_3)), Data2=simplify(graft(shift_list_10)))
number_slider_12 = Slider(0.1, range=0..1)

# ---- group: 板厚度
number_slider_13 = Slider(0.1, range=0..1)

# ----
loft = Loft(Curves=merge_9, Options={Adjust=False, Closed=False, LoftEnds=0, LoftSimp=0, LoftType=0, Rebuild=10, Refit=0.01})
brep_edges = BrepEdges(Brep=loft)  # -> Naked, Interior, NonManifold
loft_2 = Loft(Curves=merge_10, Options={Adjust=False, Closed=False, LoftEnds=0, LoftSimp=0, LoftType=0, Rebuild=10, Refit=0.01})
brep_edges_2 = BrepEdges(Brep=loft_2)  # -> Naked, Interior, NonManifold
loft_3 = Loft(Curves=merge_6, Options={Adjust=False, Closed=False, LoftEnds=0, LoftSimp=0, LoftType=0, Rebuild=10, Refit=0.01})
brep_edges_3 = BrepEdges(Brep=loft_3)  # -> Naked, Interior, NonManifold
loft_4 = Loft(Curves=merge_8, Options={Adjust=False, Closed=False, LoftEnds=0, LoftSimp=0, LoftType=0, Rebuild=10, Refit=0.01})
brep_edges_4 = BrepEdges(Brep=loft_4)  # -> Naked, Interior, NonManifold
loft_5 = Loft(Curves=merge_7, Options={Adjust=False, Closed=False, LoftEnds=0, LoftSimp=0, LoftType=0, Rebuild=10, Refit=0.01})
brep_edges_5 = BrepEdges(Brep=loft_5)  # -> Naked, Interior, NonManifold

# ---- group: 横向耽板
extrude_3 = Extrude(Base=extrude_2, Direction=expr("-x", unit_z_15))

# ---- group: 片
loft_6 = Loft(Curves=merge_14, Options={Adjust=False, Closed=False, LoftEnds=0, LoftSimp=0, LoftType=0, Rebuild=10, Refit=0.01})
loft_7 = Loft(Curves=merge_15, Options={Adjust=False, Closed=False, LoftEnds=0, LoftSimp=0, LoftType=0, Rebuild=10, Refit=0.01})
loft_8 = Loft(Curves=merge_11, Options={Adjust=False, Closed=False, LoftEnds=0, LoftSimp=0, LoftType=0, Rebuild=10, Refit=0.01})
loft_9 = Loft(Curves=merge_13, Options={Adjust=False, Closed=False, LoftEnds=0, LoftSimp=0, LoftType=0, Rebuild=10, Refit=0.01})
loft_10 = Loft(Curves=merge_12, Options={Adjust=False, Closed=False, LoftEnds=0, LoftSimp=0, LoftType=0, Rebuild=10, Refit=0.01})

# ----
multiplication_9 = Multiplication(A=rotate_3.Geometry, B=Slider(0.3, range=0..1))

construct_domain_4 = ConstructDomain(DomainStart=0, DomainEnd=1)
range_4 = Range(Domain=construct_domain_4, Steps=number_slider_2)
graph_mapper_4 = GraphMapper(
    range_4,
    x0=0,
    x1=1,
    y0=0,
    y1=1,
    container_name="Sinc",
    Equation_X0=0.5,
    Equation_X1=0.8845497966,
    Equation_Y0=0.8,
    Equation_Y1=0.3595120907)
multiplication_10 = Multiplication(A=graph_mapper_4, B=Slider(1, range=0..10))  # -> simplify(graft(Result))

construct_domain_5 = ConstructDomain(DomainStart=0, DomainEnd=1)
range_5 = Range(Domain=construct_domain_5, Steps=number_slider_2)
graph_mapper_5 = GraphMapper(
    range_5,
    x0=0,
    x1=1,
    y0=0,
    y1=1,
    container_name="Bezier",
    cpx=[0, 0.4903086722, 0.6426577568, 1],
    cpy=[0.7888350487, 0.2342545986, 0.7261527777, 0.9537888765])
multiplication_11 = Multiplication(A=graph_mapper_5, B=Slider(1, range=0..10))  # -> simplify(graft(Result))

construct_domain_6 = ConstructDomain(DomainStart=0, DomainEnd=1)
range_6 = Range(Domain=construct_domain_6, Steps=number_slider_2)
graph_mapper_6 = GraphMapper(range_6, x0=0, x1=1, y0=0, y1=1, Ox=0.512077868, Oy=0.6347020864, Px=1, Py=0.520547986, container_name="Parabola")
multiplication_12 = Multiplication(A=graph_mapper_6, B=Slider(1, range=0..10))  # -> simplify(graft(Result))

construct_domain_7 = ConstructDomain(DomainStart=0, DomainEnd=1)
range_7 = Range(Domain=construct_domain_7, Steps=number_slider_2)
graph_mapper_7 = GraphMapper(
    range_7,
    x0=0,
    x1=1,
    y0=0,
    y1=1,
    container_name="Bezier",
    cpx=[0, 0.8884542584, 0.3655775785, 1],
    cpy=[0.783515811, 0.7512842417, 0.5041720867, 0.4719388485])
multiplication_13 = Multiplication(A=graph_mapper_7, B=Slider(1, range=0..10))  # -> simplify(graft(Result))

construct_domain_8 = ConstructDomain(DomainStart=0, DomainEnd=1)
range_8 = Range(Domain=construct_domain_8, Steps=number_slider_2)
graph_mapper_8 = GraphMapper(
    range_8,
    x0=0,
    x1=1,
    y0=0,
    y1=1,
    container_name="Bezier",
    cpx=[0, 0.703625679, 0.4486986101, 1],
    cpy=[0.5808205605, 0.344062686, 0.680103898, 0.8440719843])
multiplication_14 = Multiplication(A=graph_mapper_8, B=Slider(1, range=0..10))  # -> simplify(graft(Result))

curve_middle = CurveMiddle(Curve=brep_edges_2.Naked)
curve_middle_2 = CurveMiddle(Curve=brep_edges.Naked)
curve_middle_3 = CurveMiddle(Curve=brep_edges_3.Naked)
curve_middle_4 = CurveMiddle(Curve=brep_edges_4.Naked)
curve_middle_5 = CurveMiddle(Curve=brep_edges_5.Naked)

# ---- group: 老1
curve_8 = Curve(dispatch.ListA)

# ---- group: 老2
curve_9 = Curve(dispatch.ListB)

# ----
move_16 = Move(Geometry=divide_curve_14.Points, Motion=expr("-X", unit_x))  # -> Geometry, Transform
move_17 = Move(Geometry=divide_curve_15.Points, Motion=expr("-X", unit_x_2))  # -> Geometry, Transform
move_18 = Move(Geometry=divide_curve_16.Points, Motion=expr("-X", unit_x_3))  # -> Geometry, Transform

# ---- group: 竖向杆件
unit_z_16 = UnitZ(Factor=line_11)
extrude_4 = Extrude(Base=divide_length.Points, Direction=expr("-x", unit_z_16))
pipe = Pipe(Curve=extrude_4, Radius=Slider(0.05, range=0..0.2), Caps=1, FitRail=False)

# ----
brep_edges_6 = BrepEdges(Brep=loft_7)  # -> Naked, Interior, NonManifold
brep_edges_7 = BrepEdges(Brep=loft_6)  # -> Naked, Interior, NonManifold
deconstruct = Deconstruct(Point=curve_middle_2)  # -> XComponent, YComponent, ZComponent
deconstruct_2 = Deconstruct(Point=curve_middle)  # -> XComponent, YComponent, ZComponent
deconstruct_3 = Deconstruct(Point=curve_middle_3)  # -> XComponent, YComponent, ZComponent
deconstruct_4 = Deconstruct(Point=curve_middle_4)  # -> XComponent, YComponent, ZComponent
deconstruct_5 = Deconstruct(Point=curve_middle_5)  # -> XComponent, YComponent, ZComponent
unit_x_4 = UnitX(Factor=number_slider_12)
unit_x_5 = UnitX(Factor=number_slider_12)
unit_x_6 = UnitX(Factor=number_slider_12)
unit_x_7 = UnitX(Factor=number_slider_12)
unit_x_8 = UnitX(Factor=number_slider_12)
brep_edges_8 = BrepEdges(Brep=loft_9)  # -> Naked, Interior, NonManifold
move_19 = Move(Geometry=curve_8, Motion=expr("-x", multiplication_9))  # -> Geometry, Transform
brep_edges_9 = BrepEdges(Brep=loft_8)  # -> Naked, Interior, NonManifold
brep_edges_10 = BrepEdges(Brep=loft_10)  # -> Naked, Interior, NonManifold
line_12 = Line(StartPoint=move_16.Geometry, EndPoint=move_17.Geometry)
line_13 = Line(StartPoint=divide_curve_13.Points, EndPoint=move_16.Geometry)
sort_list = SortList(Keys=deconstruct.ZComponent, ValuesValuesA=brep_edges.Naked)  # -> Keys, ValuesValuesA
sort_list_2 = SortList(Keys=deconstruct_2.ZComponent, ValuesValuesA=brep_edges_2.Naked)  # -> Keys, ValuesValuesA
line_14 = Line(StartPoint=move_17.Geometry, EndPoint=move_18.Geometry)
sort_list_3 = SortList(Keys=deconstruct_3.ZComponent, ValuesValuesA=brep_edges_3.Naked)  # -> Keys, ValuesValuesA
sort_list_4 = SortList(Keys=deconstruct_4.ZComponent, ValuesValuesA=brep_edges_4.Naked)  # -> Keys, ValuesValuesA
extrude_5 = Extrude(Base=loft_2, Direction=unit_x_4)
extrude_6 = Extrude(Base=loft, Direction=unit_x_5)
extrude_7 = Extrude(Base=loft_4, Direction=unit_x_6)
extrude_8 = Extrude(Base=loft_3, Direction=unit_x_7)
extrude_9 = Extrude(Base=loft_5, Direction=unit_x_8)
sort_list_5 = SortList(Keys=deconstruct_5.ZComponent, ValuesValuesA=brep_edges_5.Naked)  # -> Keys, ValuesValuesA
end_points_6 = EndPoints(Curve=move_19.Geometry)  # -> Start, End
end_points_7 = EndPoints(Curve=curve_9)  # -> Start, End
curve_middle_6 = CurveMiddle(Curve=brep_edges_6.Naked)
curve_middle_7 = CurveMiddle(Curve=brep_edges_7.Naked)
curve_middle_8 = CurveMiddle(Curve=brep_edges_9.Naked)
curve_middle_9 = CurveMiddle(Curve=brep_edges_8.Naked)
curve_middle_10 = CurveMiddle(Curve=brep_edges_10.Naked)
list_item_3 = ListItem(List=sort_list_2.ValuesValuesA, Index=0, Wrap=True)
list_item_4 = ListItem(List=sort_list.ValuesValuesA, Index=0, Wrap=True)
list_item_5 = ListItem(List=sort_list_4.ValuesValuesA, Index=0, Wrap=True)
list_item_6 = ListItem(List=sort_list_3.ValuesValuesA, Index=0, Wrap=True)
list_item_7 = ListItem(List=sort_list_5.ValuesValuesA, Index=0, Wrap=True)
point = Point(end_points_6.Start)
point_2 = Point(end_points_7.Start)

line_15 = Line(StartPoint=divide_curve_13.Points, EndPoint=divide_curve_14.Points)
line_16 = Line(StartPoint=divide_curve_14.Points, EndPoint=divide_curve_15.Points)
line_17 = Line(StartPoint=divide_curve_15.Points, EndPoint=divide_curve_16.Points)

line_18 = Line(StartPoint=divide_curve_15.Points, EndPoint=move_17.Geometry)
line_19 = Line(StartPoint=divide_curve_14.Points, EndPoint=move_16.Geometry)
line_20 = Line(StartPoint=divide_curve_16.Points, EndPoint=move_18.Geometry)

weave = Weave(Pattern=[0, 1], Stream0=point_2, Stream1=point, NullGaps=False)
deconstruct_6 = Deconstruct(Point=curve_middle_7)  # -> XComponent, YComponent, ZComponent
deconstruct_7 = Deconstruct(Point=curve_middle_6)  # -> XComponent, YComponent, ZComponent
deconstruct_8 = Deconstruct(Point=curve_middle_8)  # -> XComponent, YComponent, ZComponent
deconstruct_9 = Deconstruct(Point=curve_middle_9)  # -> XComponent, YComponent, ZComponent
deconstruct_10 = Deconstruct(Point=curve_middle_10)  # -> XComponent, YComponent, ZComponent

curve_middle_11 = CurveMiddle(Curve=list_item_4)
curve_middle_12 = CurveMiddle(Curve=list_item_3)
curve_middle_13 = CurveMiddle(Curve=list_item_5)
curve_middle_14 = CurveMiddle(Curve=list_item_6)
curve_middle_15 = CurveMiddle(Curve=list_item_7)

merge_16 = Merge(Data1=line_13, Data2=line_12, Data3=line_14)

# ---- group: 折
polyline = PolyLine(Vertices=weave, Closed=False)

# ----
sort_list_6 = SortList(Keys=deconstruct_6.ZComponent, ValuesValuesA=brep_edges_7.Naked)  # -> Keys, ValuesValuesA
sort_list_7 = SortList(Keys=deconstruct_7.ZComponent, ValuesValuesA=brep_edges_6.Naked)  # -> Keys, ValuesValuesA
sort_list_8 = SortList(Keys=deconstruct_8.ZComponent, ValuesValuesA=brep_edges_9.Naked)  # -> Keys, ValuesValuesA
sort_list_9 = SortList(Keys=deconstruct_9.ZComponent, ValuesValuesA=brep_edges_8.Naked)  # -> Keys, ValuesValuesA
sort_list_10 = SortList(Keys=deconstruct_10.ZComponent, ValuesValuesA=brep_edges_10.Naked)  # -> Keys, ValuesValuesA

merge_17 = Merge(Data1=line_15, Data2=line_16, Data3=line_17)

merge_18 = Merge(Data1=line_19, Data2=line_18, Data3=line_20)

unit_x_9 = UnitX(Factor=Slider(0.75, range=0..1))

# ---- group: Final_Result
merge_19 = Merge(Data1=extrude_5, Data2=extrude_6, Data3=extrude_7, Data4=extrude_8, Data5=extrude_9)

# ----
unit_y = UnitY(Factor=Slider(0.25, range=0..1))

# ---- group: 折 分
explode_object = ExplodeObject(Object=polyline, Recursive=False)

# ----
list_item_8 = ListItem(List=sort_list_7.ValuesValuesA, Index=0, Wrap=True)  # -> Item, Item1, Item2
list_item_9 = ListItem(List=sort_list_9.ValuesValuesA, Index=0, Wrap=True)  # -> Item, Item1, Item2
list_item_10 = ListItem(List=sort_list_6.ValuesValuesA, Index=0, Wrap=True)  # -> Item, Item1, Item2
list_item_11 = ListItem(List=sort_list_8.ValuesValuesA, Index=0, Wrap=True)  # -> Item, Item1, Item2
list_item_12 = ListItem(List=sort_list_10.ValuesValuesA, Index=0, Wrap=True)  # -> Item, Item1, Item2
extrude_10 = Extrude(Base=merge_16, Direction=expr("-x", unit_x_9))
group_2 = Group(Geometry=flatten(merge_19))

construct_domain_9 = ConstructDomain(DomainStart=0, DomainEnd=1)
range_9 = Range(Domain=construct_domain_9, Steps=number_slider_3)
graph_mapper_9 = GraphMapper(range_9, x0=0, x1=1, y0=0, y1=1, container_name="Sine", Equation_px=[0, 1], Equation_py=[0.06327313185, 0.3093810081])
multiplication_15 = Multiplication(A=graph_mapper_9, B=Slider(1, range=0..10))  # -> graft(Result)

construct_domain_10 = ConstructDomain(DomainStart=0, DomainEnd=1)
range_10 = Range(Domain=construct_domain_10, Steps=number_slider_3)
graph_mapper_10 = GraphMapper(
    range_10,
    x0=0,
    x1=1,
    y0=0,
    y1=1,
    container_name="Sine",
    Equation_px=[0.003626726568, 1],
    Equation_py=[0.3195641637, 0.003379046917])
multiplication_16 = Multiplication(A=graph_mapper_10, B=Slider(1, range=0..10))  # -> graft(Result)

construct_domain_11 = ConstructDomain(DomainStart=0, DomainEnd=1)
range_11 = Range(Domain=construct_domain_11, Steps=number_slider_3)
graph_mapper_11 = GraphMapper(
    range_11,
    x0=0,
    x1=1,
    y0=0,
    y1=1,
    container_name="Sine",
    Equation_px=[0.0157028418, 1],
    Equation_py=[0.09685838223, 0.2939594388])
multiplication_17 = Multiplication(A=graph_mapper_11, B=Slider(1, range=0..10))  # -> graft(Result)

construct_domain_12 = ConstructDomain(DomainStart=0, DomainEnd=1)
range_12 = Range(Domain=construct_domain_12, Steps=number_slider_3)
graph_mapper_12 = GraphMapper(range_12, x0=0, x1=1, y0=0, y1=1, container_name="Sine", Equation_px=[0, 1], Equation_py=[0.2801920772, 0.1069919467])
multiplication_18 = Multiplication(A=graph_mapper_12, B=Slider(1, range=0..10))  # -> graft(Result)

construct_domain_13 = ConstructDomain(DomainStart=0, DomainEnd=1)
range_13 = Range(Domain=construct_domain_13, Steps=number_slider_3)
graph_mapper_13 = GraphMapper(range_13, x0=0, x1=1, y0=0, y1=1, container_name="Sine", Equation_px=[0, 0.9188603759], Equation_py=[0, 0.8304973841])
multiplication_19 = Multiplication(A=graph_mapper_13, B=Slider(1, range=0..10))  # -> graft(Result)

curve_middle_16 = CurveMiddle(Curve=list_item_8.Item)
curve_middle_17 = CurveMiddle(Curve=list_item_10.Item)
extrude_11 = Extrude(Base=extrude_10, Direction=unit_y)
curve_middle_18 = CurveMiddle(Curve=list_item_9.Item)
curve_middle_19 = CurveMiddle(Curve=list_item_11.Item)
curve_middle_20 = CurveMiddle(Curve=list_item_12.Item)
pipe_2 = Pipe(Curve=[merge_17, merge_18], Radius=Slider(0.05, range=0..0.1), Caps=1, FitRail=False)
group_3 = Group(Geometry=extrude_11)
group_4 = Group(Geometry=flatten(pipe_2))
panel_2 = Panel(multiplication_14)

scale = Scale(Geometry=list_item_3, Center=curve_middle_12, Factor=multiplication_14)  # -> Geometry, Transform
unit_z_17 = UnitZ(Factor=number_slider)
extrude_12 = Extrude(Base=scale.Geometry, Direction=unit_z_17)

scale_2 = Scale(Geometry=list_item_4, Center=curve_middle_11, Factor=multiplication_13)  # -> Geometry, Transform
unit_z_18 = UnitZ(Factor=number_slider)
extrude_13 = Extrude(Base=scale_2.Geometry, Direction=unit_z_18)

scale_3 = Scale(Geometry=list_item_5, Center=curve_middle_13, Factor=multiplication_12)  # -> Geometry, Transform
unit_z_19 = UnitZ(Factor=number_slider)
extrude_14 = Extrude(Base=scale_3.Geometry, Direction=unit_z_19)

scale_4 = Scale(Geometry=list_item_6, Center=curve_middle_14, Factor=multiplication_10)  # -> Geometry, Transform
unit_z_20 = UnitZ(Factor=number_slider)
extrude_15 = Extrude(Base=scale_4.Geometry, Direction=unit_z_20)

scale_5 = Scale(Geometry=list_item_7, Center=curve_middle_15, Factor=multiplication_11)  # -> Geometry, Transform
unit_z_21 = UnitZ(Factor=number_slider)
extrude_16 = Extrude(Base=scale_5.Geometry, Direction=unit_z_21)

往内缩 = 往内缩(point_b=curve_middle_16, curve=list_item_8.Item1, curve_2=list_item_8.Item2)
往内缩_2 = 往内缩(point_b=curve_middle_17, curve=list_item_10.Item1, curve_2=list_item_10.Item2)
往内缩_3 = 往内缩(point_b=curve_middle_18, curve=list_item_9.Item1, curve_2=list_item_9.Item2)
往内缩_4 = 往内缩(point_b=curve_middle_19, curve=list_item_11.Item1, curve_2=list_item_11.Item2)
往内缩_5 = 往内缩(point_b=curve_middle_20, curve=list_item_12.Item1, curve_2=list_item_12.Item2)
surface = Surface(往内缩)
surface_2 = Surface(往内缩_2)
surface_3 = Surface(往内缩_3)
surface_4 = Surface(往内缩_5)
surface_5 = Surface(往内缩_4)

# ---- group: 加厚
unit_x_10 = UnitX(Factor=number_slider_13)
unit_x_11 = UnitX(Factor=number_slider_13)
unit_x_12 = UnitX(Factor=number_slider_13)
unit_x_13 = UnitX(Factor=number_slider_13)
unit_x_14 = UnitX(Factor=number_slider_13)
extrude_17 = Extrude(Base=surface_2, Direction=unit_x_10)
extrude_18 = Extrude(Base=surface, Direction=unit_x_11)
extrude_19 = Extrude(Base=surface_3, Direction=unit_x_12)
extrude_20 = Extrude(Base=surface_5, Direction=unit_x_13)
extrude_21 = Extrude(Base=surface_4, Direction=unit_x_14)

# ----
list_length = ListLength(List=divide_length.Points)
vector_3 = Vector(unit_vector)
pi_4 = Pi(Factor=multiplication_15)
pi_5 = Pi(Factor=multiplication_16)
pi_6 = Pi(Factor=multiplication_19)
pi_7 = Pi(Factor=multiplication_17)
pi_8 = Pi(Factor=multiplication_18)
series_3 = Series(Start=0, Step=number_slider_8, Count=list_length)

# ---- group: *横向间距
multiplication_20 = Multiplication(A=vector_3, B=number_slider_8)

# ----
extrude_22 = Extrude(Base=explode_object, Direction=multiplication_20)  # -> simplify(graft(Extrusion))

# ---- group: 分一半一半
series_4 = Series(Start=0, Step=1, Count=number_slider_9)
modulus_2 = Modulus(A=series_4, B=Slider(2, range=0..10))
dispatch_2 = Dispatch(List=flatten(extrude_22), DispatchPattern=modulus_2)  # -> ListA, ListB
panel_3 = Panel(modulus_2)

# ----
multiplication_21 = Multiplication(B=pi_4)
rotate_4 = Rotate(Geometry=extrude_18, Angle=multiplication_21, Plane=curve_middle_16)  # -> Geometry, Transform
multiplication_22 = Multiplication(B=pi_5)
rotate_5 = Rotate(Geometry=extrude_17, Angle=multiplication_22, Plane=curve_middle_17)  # -> Geometry, Transform
multiplication_23 = Multiplication(B=pi_6)
rotate_6 = Rotate(Geometry=extrude_21, Angle=multiplication_23, Plane=curve_middle_19)  # -> Geometry, Transform
multiplication_24 = Multiplication(B=pi_7)
rotate_7 = Rotate(Geometry=extrude_19, Angle=multiplication_24, Plane=curve_middle_18)  # -> Geometry, Transform
multiplication_25 = Multiplication(B=pi_8)
rotate_8 = Rotate(Geometry=extrude_20, Angle=multiplication_25, Plane=curve_middle_19)  # -> Geometry, Transform
multiplication_26 = Multiplication(A=vector_3, B=series_3)
merge_20 = Merge(Data1=extrude_12, Data2=extrude_13, Data3=extrude_14, Data4=extrude_15, Data5=extrude_16)

# ---- group: 周边⚪框
pipe_3 = Pipe(Curve=merge_5, Radius=Slider(0.02, range=0..0.1), Caps=1, FitRail=False)
group_5 = Group(Geometry=flatten(pipe_3))

# ---- group: 扇叶_Final_Result
merge_21 = Merge(
    Data1=rotate_4.Geometry,
    Data2=rotate_5.Geometry,
    Data3=rotate_7.Geometry,
    Data4=rotate_8.Geometry,
    Data5=rotate_6.Geometry)

# ---- group: 上，不动
surface_6 = Surface(dispatch_2.ListB)

# ---- group: 下，到底部的距离线性开窗
surface_7 = Surface(dispatch_2.ListA)

# ----
extrude_23 = Extrude(Base=merge_20, Direction=multiplication_4)

# ---- group: base line
curve_10 = Curve(merge_5)
group_6 = Group(Geometry=flatten(curve_10))

# ---- group: 横向耽板
group_7 = Group(Geometry=flatten(extrude_3))

# ---- group: Scale后的finalModel
group_8 = Group(Geometry=flatten(merge_21))

# ----
merge_22 = Merge(Data1=group_8, Data2=group_7)

# ---- group: 线性渐变开窗户 / 下侧开窗上下限
construct_domain_14 = ConstructDomain(DomainStart=Slider(0.2, range=0..1), DomainEnd=Slider(0.7, range=0..1))

# ---- group: 线性渐变开窗户
brep_edges_11 = BrepEdges(Brep=surface_7)  # -> simplify(Naked), Interior, NonManifold
curve_middle_21 = CurveMiddle(Curve=brep_edges_11.Naked)
deconstruct_11 = Deconstruct(Point=curve_middle_21)  # -> XComponent, YComponent, ZComponent
sort_list_11 = SortList(Keys=deconstruct_11.ZComponent, ValuesValuesA=brep_edges_11.Naked)  # -> Keys, ValuesValuesA
reverse_list_2 = ReverseList(List=sort_list_11.ValuesValuesA)
list_item_13 = ListItem(List=sort_list_11.ValuesValuesA, Index=0, Wrap=True)
list_item_14 = ListItem(List=reverse_list_2, Index=0, Wrap=True)  # -> Item, Item1
length = Length(Curve=list_item_14.Item1)
panel_4 = Panel(length)

# ---- group: 线性渐变开窗户 / 下线
curve_11 = Curve(list_item_13)

# ---- group: 线性渐变开窗户 / 上线
curve_12 = Curve(list_item_14.Item)

# ---- group: 线性渐变开窗户 (continued)
curve_middle_22 = CurveMiddle(Curve=curve_11)
curve_middle_23 = CurveMiddle(Curve=curve_12)
line_21 = Line(StartPoint=curve_middle_23, EndPoint=curve_middle_22)
vector_2pt_12 = Vector2Pt(PointA=curve_middle_23, PointB=curve_middle_22, Unitize=False)  # -> Vector, Length
vector_display_ex = VectorDisplayEx(Point=curve_middle_23, Vector=vector_2pt_12.Vector, Colour=RGB(0, 0, 0), Width=2)

list_length_2 = ListLength(List=flatten(list_item_13))  # -> flatten(Length)
series_5 = Series(Start=0, Step=Slider(0.1, range=0..0.1), Count=list_length_2)  # -> reverse(simplify(Series))

# ---- group: 线性渐变开窗户 / remap for once
remap_numbers = RemapNumbers(Value=series_5, Source=Domain(0, 1), Target=construct_domain_14)  # -> Mapped, Clipped

# ---- group: 线性渐变开窗户 (continued)
multiplication_27 = Multiplication(A=vector_2pt_12.Vector, B=graft(remap_numbers.Clipped))

# ---- group: 线性渐变开窗户 / 上线和下线的开窗
move_20 = Move(Geometry=curve_11, Motion=expr("-x", simplify(multiplication_27)))  # -> Geometry, Transform

# ---- group: 线性渐变开窗户 (continued)
flip_curve = FlipCurve(Curve=move_20.Geometry, Guide=curve_12)  # -> Curve, Flag
merge_23 = Merge(Data1=curve_12, Data2=flip_curve.Curve)

# ----
loft_11 = Loft(Curves=merge_23, Options={Adjust=False, Closed=False, LoftEnds=0, LoftSimp=0, LoftType=0, Rebuild=10, Refit=0.01})
merge_24 = Merge(Data1=loft_11, Data2=surface_6)
move_21 = Move(Geometry=simplify(flatten(merge_24)), Motion=graft(multiplication_26))  # -> simplify(Geometry), Transform
geometry_2 = Geometry(flatten(move_21.Geometry))

# ==== cluster 往内缩
curve = ClusterInput()
curve_2 = ClusterInput()
curve_3 = Curve(simplify(curve))
curve_4 = Curve(curve_2)
end_points = EndPoints(Curve=curve_3)  # -> Start, End
point = Point(end_points.End)
point_b = ClusterInput()
vector_2pt = Vector2Pt(PointA=point, PointB=point_b, Unitize=False)  # -> Vector, Length
multiplication = Multiplication(A=vector_2pt.Vector, B=graft(Slider(0.3, range=0..1)))  # -> simplify(Result)
move = Move(Geometry=curve_3, Motion=multiplication)  # -> Geometry, Transform
flip_curve = FlipCurve(Curve=curve_4, Guide=move.Geometry)  # -> Curve, Flag
merge = Merge(Data1=move.Geometry, Data2=simplify(flip_curve.Curve))
loft = Loft(Curves=merge, Options={Adjust=False, Closed=False, LoftEnds=0, LoftSimp=0, LoftType=0, Rebuild=10, Refit=0.01})
loft_2 = ClusterOutput(loft)
